# Dynamo graph WORKFLOW_TrimbleGEDO_REC_TOPOImport_v1_71.dyn (Dynamo 3.6.1.9956)
# author: Veres Fanni
# TRIMBLE Gedo Rec vágány és TOPO pont méréseinek feldolgozása.
# Kiválasztandó bemenő file-ok:
# 1.) GEDO Office-ból kiexportált vágánytengely és sínszálpontok CSV formátumban.
# Filenévsablon: ProjektEvHonapNap_feldolgozott_xxSzakasz
# 2.) Nyers TOPO mérési pontok CSV formában.
# Filenévsablon: ProjektEvHonapNap_GEDO_xxSzakasz_topo

# group: Bemenő adatok
# Mérési file kiválasztása a számítógépen.
# EOV koordinátarendszer beállítása a megnyitott dokumentumban
# note: Vágánygeometria mérési file kiválasztása (feldolgozott)
vaganyfajl_betöltése = Filename("INPUT fájlok\Szentgal260417_feldolgozott_02szakasz.csv")  # graph input
# note: A megnyitott aktív dokumentum lekérése
current = Autodesk.AutoCAD.DynamoNodes.Document.Current()
# note: Autodesk Civil 3D koordináta-rendszerkód
string = StringInput("HD72/7Pa.EOV")
# note: Kiválasztott koordináta rendszer beállítása az aktív dokumentumban
setCoordinateReferenceSystem = Autodesk.AutoCAD.DynamoNodes.Document.SetCoordinateReferenceSystem(document=current, code=string)

# note: csv file importálása
importCSV = Data.ImportCSV(filePath=vaganyfajl_betöltése)

# group: Felesleges sorok eltávolítása
# Fejléc első 5 sorának eltávolítása
code_block = CodeBlock { [0,1,2,3,4]; }
# note: fejléc felesleges sorainak eltávolítása
removeItemAtIndex = List.RemoveItemAtIndex(list=importCSV@L2, indices=code_block)

# group: Dynamo pontok létrehozása
# Adatok rendezése oszloponként, majd xyz koordináták megadása a pontok létrehozásához.
# note: Adatok kigyűjtése oszloponként, listába rendezés
code_block_2 = CodeBlock(RawData=removeItemAtIndex)
# ---------- code_block_2.designscript (31 lines) ----------
RawData;
//Name
PontNev = List.GetItemAtIndex(RawData,0);
// Code
PontKod = List.GetItemAtIndex(RawData,1);
// Bal sinszál X
BS_East = List.GetItemAtIndex(RawData,2);
// Bal sinszál Y
BS_North = List.GetItemAtIndex(RawData,3);
// Bal sinszál Z
BS_Elev = List.GetItemAtIndex(RawData,4);
// Tengely X
T_East = List.GetItemAtIndex(RawData,5);
// Tengely Y
T_North = List.GetItemAtIndex(RawData,6);
// Tengely Z
T_Elev = List.GetItemAtIndex(RawData,7);
// Jobb sinszál X
JS_East = List.GetItemAtIndex(RawData,8);
// Jobb sinszál Y
JS_North = List.GetItemAtIndex(RawData,9);
// Jobb sinszál Z
JS_Elev = List.GetItemAtIndex(RawData,10);
//Cant[mm]
Tulemeles = List.GetItemAtIndex(RawData,11);
//Gauge[mm]
Nyomtav = List.GetItemAtIndex(RawData,12);
//Chainage[m]
Szelveny = List.GetItemAtIndex(RawData,13);
//LineName
LineName = List.GetItemAtIndex(RawData,14);
# ----------------------------------------
# note: Vágánytengely pontok
byCoordinates = Point.ByCoordinates(x=code_block_2.T_East, y=code_block_2.T_North, z=code_block_2.T_Elev)
# note: Bal sínszál pontok
byCoordinates_2 = Point.ByCoordinates(x=code_block_2.BS_East, y=code_block_2.BS_North, z=code_block_2.BS_Elev)
# note: Jobb sínszál pontok
byCoordinates_3 = Point.ByCoordinates(x=code_block_2.JS_East, y=code_block_2.JS_North, z=code_block_2.JS_Elev)

# note: Vonal név
code_block_3 = CodeBlock(lineName=code_block_2.LineName) { VonalNev_STRING = lineName[0]; }

# group: Nyomvonal létrehozása
# Nyomvonal létrehozása a mért vágánytengely pontokból. Elnevezés, kezdőszelvény megadása, típusának beállítása is megtörténik.
pruneDuplicates = Point.PruneDuplicates(points=byCoordinates)
code_block_4 = CodeBlock(a=code_block_2.Szelveny) { a[0]; }
choose_alignment_type = EnumAlignmentType("Rail", EnumDictionary={Utility: "Miscellaneous", Rail: "Rail", Centerline: "Centerline", CurbReturn: "Curb Return", Offset: "Offset"})
byPoints = Autodesk.Civil.DynamoNodes.Alignment.ByPoints(points=pruneDuplicates, name=code_block_3, startStation=code_block_4, type=choose_alignment_type)

# group: Nyomvonal megjelenítés és felirat stílus
# Nyomvonal stílusának beállítása.
code_block_5 = CodeBlock { "VF_Tengely"; }
# note: megjelenítési stílus (színek)
setStyle = Autodesk.Civil.DynamoNodes.CivilObject.SetStyle(civilObject=byPoints, styleName=code_block_5)
code_block_6 = CodeBlock { "_No Labels"; }
# note: felirat stílusa
importLabelSet = Autodesk.Civil.DynamoNodes.Alignment.ImportLabelSet(alignment=setStyle, labelSetName=code_block_6)  # graph output

# group: Hossz szelvény létrehozása
# Hossz szelvény létrehozása és stílusának beállítása.
code_block_7 = CodeBlock { "Sinkorona"; }
# note: nyomvonal kiválasztása, amire a hsz készül - szelvények miatt
stationOffsetByPoint = Autodesk.Civil.DynamoNodes.Alignment.StationOffsetByPoint(alignment=byPoints, point=byCoordinates)
Z = Point.Z(point=byCoordinates)
byStationsElevations = Autodesk.Civil.DynamoNodes.Profile.ByStationsElevations(alignment=importLabelSet, name=code_block_7, pviStations=stationOffsetByPoint.Station, pviElevations=Z)  # graph output

# group: 3D Poliline - Bal sinszál
# AutoCad 3D vonallánc létrehozása a Dynamo pontokból
code_block_8 = CodeBlock { 0.25; }
# note: Az egymáshoz túl közeli pontok kiszűrése a megadott tolerancia figyelembe vételével
pruneDuplicates_2 = Point.PruneDuplicates(points=byCoordinates_2, tolerance=code_block_8)
# note: Lista elemszáma
count = List.Count(list=pruneDuplicates_2)
# note: lista kettébontása
code_block_9 = CodeBlock(Pontok=pruneDuplicates_2, N=count) { KezdoPont = Pontok[0..N-2]; VegPont = Pontok[1..N-1]; }
# note: Rész vonalszakaszok létrehozása a pontokból
byStartPointEndPoint = Line.ByStartPointEndPoint(startPoint=code_block_9.KezdoPont, endPoint=code_block_9.VegPont)
# note: Vonalszakaszok egyesítése Dynamo vonalláncá
byJoinedCurves = PolyCurve.ByJoinedCurves(curves=byStartPointEndPoint)
# note: Fólia név
code_block_10 = CodeBlock(VonalNev=code_block_3) { "VF_SZG_GEOD_" + VonalNev + "_BalSinszal"; }

# group: Jobb sínszál stílus
# Jobb sínszál stílusának beállítása.
color_palette = ColorPalette({R: 255, G: 0, B: 0, A: 255})
choose_lineweight = Lineweight("0.18 mm")
byName = Autodesk.AutoCAD.DynamoNodes.Layer.ByName(name=code_block_10, document=setCoordinateReferenceSystem, color=color_palette, lineweight=choose_lineweight)

name = Autodesk.AutoCAD.DynamoNodes.Layer.Name(layer=byName)

# group (continued): 3D Poliline - Bal sinszál
# note: Dynamo geometriából AutoCad geometria létrehozása
byGeometry = Autodesk.AutoCAD.DynamoNodes.Polyline3D.ByGeometry(curve=byJoinedCurves, layerName=name)  # graph output

# group: 3D Poliline - Vágánytengely
# AutoCad 3D vonallánc létrehozása a Dynamo pontokból
code_block_11 = CodeBlock { 0.25; }
pruneDuplicates_3 = Point.PruneDuplicates(points=byCoordinates, tolerance=code_block_11)
count_2 = List.Count(list=pruneDuplicates_3)
code_block_12 = CodeBlock(Pontok=pruneDuplicates_3, N=count_2) { Pontok; Pontok[0..N-2]; Pontok[1..N-1]; }
byStartPointEndPoint_2 = Line.ByStartPointEndPoint(startPoint=code_block_12.out1, endPoint=code_block_12.out2)
byJoinedCurves_2 = PolyCurve.ByJoinedCurves(curves=byStartPointEndPoint_2)
code_block_13 = CodeBlock(VonalNev=code_block_3) { "VF_SZG_GEOD_" + VonalNev+"_VaganyTengely"; }
byGeometry_2 = Autodesk.AutoCAD.DynamoNodes.Polyline3D.ByGeometry(curve=byJoinedCurves_2, layerName=code_block_13)  # graph output

# group: Bemenő adatok
# Mérési file kiválasztása a számítógépen.
# EOV koordinátarendszer beállítása.
# note: Trimble Gedo TOPO fájl
topo_fájl_betöltése = Filename("INPUT fájlok\Szentgal260417_GEDO_02szakasz_topo.csv")  # graph input

# group: FájlNév
# File nevének lekérdezése.
fileName = FileSystem.FileName(path=topo_fájl_betöltése)
code_block_14 = CodeBlock { "."; }
split = String.Split(string=fileName, separator0=code_block_14)
code_block_15 = CodeBlock(InputFileName=split) { InputFileName[0]; }

code_block_16 = CodeBlock(FaljNev=code_block_15) { FaljNev + "_" + "AllCogoPoints"; }

# group: Adatok rendezése
# Felesleges oszlopok eltávolítása, lényeges adatok beolvasása.
# note: csv file importálása
importCSV_2 = Data.ImportCSV(filePath=topo_fájl_betöltése)
# note: szükséges adatok kigyűjtése (diagnosztika nem kell)
code_block_17 = CodeBlock(Rawdata=importCSV_2)
# ---------- code_block_17.designscript (10 lines) ----------
//ID
List.RestOfItems(Rawdata[0]);
// Code
List.RestOfItems(Rawdata[1]);
// Easting
List.RestOfItems(Rawdata[2]);
// Northing
List.RestOfItems(Rawdata[3]);
// Elevation
List.RestOfItems(Rawdata[4]);
# ----------------------------------------

# group: Pontok és COGO pontok létrehozása
# Pontok, COGO pontok létrehozása koordinátákból.
# note: Dynamo pontok létrehozása xyz koordinátákból
byCoordinates_4 = Point.ByCoordinates(x=code_block_17.out2, y=code_block_17.out3, z=code_block_17.out4)
string_2 = StringInput("VF_SZG_GEOD_REC_Mindenpont")
# note: Mivel az ID szám, szöveget kell belőle készíteni, mert ezt tudja a Code Block összerakni leírássá.
string_from_object = FromObject(object=code_block_17.out0)
# note: Pontok leírása: ID + pontkód
code_block_18 = CodeBlock(a=string_from_object, b=code_block_17.out1) { a+"_"+b; }
byGeometry_3 = Autodesk.Civil.DynamoNodes.CogoPoint.ByGeometry(point=byCoordinates_4, layerName=string_2, rawDescription=code_block_18)  # graph output
összes_cogo_pont = List.Flatten(list=byGeometry_3)

rawDescription = Autodesk.Civil.DynamoNodes.CogoPoint.RawDescription(cogoPoint=összes_cogo_pont)
code_block_19 = CodeBlock { "_"; }
split_2 = String.Split(string=rawDescription, separator0=code_block_19)
transpose = List.Transpose(lists=split_2)
code_block_20 = CodeBlock(a=transpose) { a[1]; }

# group: Cogo pont stílus
code_block_21 = CodeBlock { "VF_Felirat"; }
setLabelStyle = Autodesk.Civil.DynamoNodes.CogoPoint.SetLabelStyle(cogoPoint=összes_cogo_pont, labelStyleName=code_block_21)
string_3 = StringInput("VF_Topo")
setStyle_2 = Autodesk.Civil.DynamoNodes.CogoPoint.SetStyle(cogoPoint=setLabelStyle, styleName=string_3)

# group: Pontkódok szűrése, azonos kódú COGO pontok csoportosítása
groupByKey = List.GroupByKey(list=setStyle_2, keys=code_block_17.out1)

# group: ZKAJ 3D vonallánc
# Zúzottkő alja jobb oldal pontok összekötése vonallánccal
code_block_22 = CodeBlock { KodSzuro = "zkaj"; }
indexOf = List.IndexOf(list=groupByKey.uniqueKeys, element=code_block_22)
code_block_23 = CodeBlock(Lista=groupByKey.groups, index=indexOf) { Lista[index]; }
easting = Autodesk.Civil.DynamoNodes.CogoPoint.Easting(cogoPoint=code_block_23)
northing = Autodesk.Civil.DynamoNodes.CogoPoint.Northing(cogoPoint=code_block_23)
elevation = Autodesk.Civil.DynamoNodes.CogoPoint.Elevation(cogoPoint=code_block_23)
byCoordinates_5 = Point.ByCoordinates(x=easting, y=northing, z=elevation)
# note: pontok merőleges vetítése a vágánytengelyre
# pontok szelvényének meghatározása
# a szelvények növekvő sorrendben való összekötése
code_block_24 = CodeBlock(Nyomvonal=importLabelSet, PontLista=byCoordinates_5)
# ---------- code_block_24.designscript (31 lines) ----------
// Function
//
//  ****************************************
//
//   result = Feltetel ? HaIgaz : HaHamis;
//
//  ****************************************
//
// Nyomvonalra illesztés
StationOffsetData = Autodesk.Civil.DynamoNodes.Alignment.StationOffsetByPoint(Nyomvonal,PontLista);
Szelveny = DesignScript.Builtin.Dictionary.ValueAtKey(StationOffsetData,"Station");

// Nyomvonalra nem illeszkedő pontok kiszűrése
idx = DSCore.List.IndexOf(Szelveny, null);
Szelveny_Jav = DSCore.List.RemoveItemAtIndex(Szelveny,idx);
Pontlista_Jav = DSCore.List.RemoveItemAtIndex(PontLista,idx);

// Condition
Feltetel =DSCore.Object.IsNull(idx);
a = DSCore.List.SortByKey(Pontlista_Jav,Szelveny_Jav);
b = DSCore.List.SortByKey(PontLista,Szelveny);
DataSorting = Feltetel ? b : a;

// Pontok összekötése
//DataSorting = DSCore.List.SortByKey(Pontlista_Jav,Szelveny_Jav);
SortedPontLista0 = DesignScript.Builtin.Dictionary.ValueAtKey(DataSorting,"sortedList");
SortedPontLista1 = Autodesk.DesignScript.Geometry.Point.PruneDuplicates(SortedPontLista0,0.0005);

n = DSCore.List.Count(SortedPontLista1);
Vonalak0 = Autodesk.DesignScript.Geometry.Line.ByStartPointEndPoint(SortedPontLista1[0.. n-2],SortedPontLista1[1.. n-1]);
Vonallanc = Autodesk.DesignScript.Geometry.PolyCurve.ByJoinedCurves(Vonalak0, 0.001, false, 0);
# ----------------------------------------
code_block_25 = CodeBlock(VonalNev=code_block_3, AktualKOD=code_block_22)
# ---------- code_block_25.designscript (2 lines) ----------
// FóliaNev
"VF_SZG_GEOD_" + VonalNev + "_" + AktualKOD;
# ----------------------------------------

# group: 3D vonallánc stílusa
color_palette_2 = ColorPalette({R: 101, G: 101, B: 101, A: 255})
choose_lineweight_2 = Lineweight("0.18 mm")
byName_2 = Autodesk.AutoCAD.DynamoNodes.Layer.ByName(name=code_block_25, document=setCoordinateReferenceSystem, color=color_palette_2, lineweight=choose_lineweight_2)
name_2 = Autodesk.AutoCAD.DynamoNodes.Layer.Name(layer=byName_2)
byGeometry_4 = Autodesk.AutoCAD.DynamoNodes.Polyline3D.ByGeometry(curve=code_block_24.Vonallanc, layerName=name_2)  # graph output

# group: ZKTJ 3D vonallánc
code_block_26 = CodeBlock { KodSzuro = "zktj"; }
indexOf_2 = List.IndexOf(list=groupByKey.uniqueKeys, element=code_block_26)
code_block_27 = CodeBlock(Lista=groupByKey.groups, index=indexOf_2) { Lista[index]; }
easting_2 = Autodesk.Civil.DynamoNodes.CogoPoint.Easting(cogoPoint=code_block_27)
northing_2 = Autodesk.Civil.DynamoNodes.CogoPoint.Northing(cogoPoint=code_block_27)
elevation_2 = Autodesk.Civil.DynamoNodes.CogoPoint.Elevation(cogoPoint=code_block_27)
byCoordinates_6 = Point.ByCoordinates(x=easting_2, y=northing_2, z=elevation_2)
code_block_28 = CodeBlock(Nyomvonal=importLabelSet, PontLista=byCoordinates_6)  # same code as code_block_24
code_block_29 = CodeBlock(VonalNev=code_block_3, AktualKOD=code_block_26)  # same code as code_block_25

# group: 3D vonallánc stílusa
color_palette_3 = ColorPalette({R: 101, G: 101, B: 101, A: 255})
choose_lineweight_3 = Lineweight("0.18 mm")
byName_3 = Autodesk.AutoCAD.DynamoNodes.Layer.ByName(name=[code_block_29, code_block_29, code_block_29, code_block_29], document=setCoordinateReferenceSystem, color=color_palette_3, lineweight=choose_lineweight_3)
name_3 = Autodesk.AutoCAD.DynamoNodes.Layer.Name(layer=byName_3)
byGeometry_5 = Autodesk.AutoCAD.DynamoNodes.Polyline3D.ByGeometry(curve=code_block_28.Vonallanc, layerName=name_3)  # graph output

# group: ZKAB 3D vonallánc
code_block_30 = CodeBlock { KodSzuro = "zkab"; }
indexOf_3 = List.IndexOf(list=groupByKey.uniqueKeys, element=code_block_30)
code_block_31 = CodeBlock(Lista=groupByKey.groups, index=indexOf_3) { Lista[index]; }
easting_3 = Autodesk.Civil.DynamoNodes.CogoPoint.Easting(cogoPoint=code_block_31)
northing_3 = Autodesk.Civil.DynamoNodes.CogoPoint.Northing(cogoPoint=code_block_31)
elevation_3 = Autodesk.Civil.DynamoNodes.CogoPoint.Elevation(cogoPoint=code_block_31)
byCoordinates_7 = Point.ByCoordinates(x=easting_3, y=northing_3, z=elevation_3)
code_block_32 = CodeBlock(Nyomvonal=importLabelSet, PontLista=byCoordinates_7)  # same code as code_block_24
code_block_33 = CodeBlock(VonalNev=code_block_3, AktualKOD=code_block_30)  # same code as code_block_25

# group: 3D vonallánc stílusa
color_palette_4 = ColorPalette({R: 101, G: 101, B: 101, A: 255})
choose_lineweight_4 = Lineweight("0.18 mm")
byName_4 = Autodesk.AutoCAD.DynamoNodes.Layer.ByName(name=code_block_33, document=setCoordinateReferenceSystem, color=color_palette_4, lineweight=choose_lineweight_4)
name_4 = Autodesk.AutoCAD.DynamoNodes.Layer.Name(layer=byName_4)
byGeometry_6 = Autodesk.AutoCAD.DynamoNodes.Polyline3D.ByGeometry(curve=code_block_32.Vonallanc, layerName=name_4)  # graph output

# group: ZKTB 3D vonallánc
code_block_34 = CodeBlock { KodSzuro = "zktb"; }
indexOf_4 = List.IndexOf(list=groupByKey.uniqueKeys, element=code_block_34)
code_block_35 = CodeBlock(Lista=groupByKey.groups, index=indexOf_4) { Lista[index]; }
easting_4 = Autodesk.Civil.DynamoNodes.CogoPoint.Easting(cogoPoint=code_block_35)
northing_4 = Autodesk.Civil.DynamoNodes.CogoPoint.Northing(cogoPoint=code_block_35)
elevation_4 = Autodesk.Civil.DynamoNodes.CogoPoint.Elevation(cogoPoint=code_block_35)
byCoordinates_8 = Point.ByCoordinates(x=easting_4, y=northing_4, z=elevation_4)
code_block_36 = CodeBlock(Nyomvonal=importLabelSet, PontLista=byCoordinates_8)
# ---------- code_block_36.designscript (32 lines) ----------
// Function
//
//  ****************************************
//
//   result = Feltetel ? HaIgaz : HaHamis;
//
//  ****************************************
//
// Nyomvonalra illesztés
StationOffsetData = Autodesk.Civil.DynamoNodes.Alignment.StationOffsetByPoint(Nyomvonal,PontLista);
Szelveny = DesignScript.Builtin.Dictionary.ValueAtKey(StationOffsetData,"Station");

// Nyomvonalra nem illeszkedő pontok kiszűrése
idx = DSCore.List.IndexOf(Szelveny, null);
Szelveny_Jav = DSCore.List.RemoveItemAtIndex(Szelveny,idx);
Pontlista_Jav = DSCore.List.RemoveItemAtIndex(PontLista,idx);

// Condition
Feltetel =DSCore.Object.IsNull(idx);
a = DSCore.List.SortByKey(Pontlista_Jav,Szelveny_Jav);
b = DSCore.List.SortByKey(PontLista,Szelveny);
DataSorting = Feltetel ? b : a;

// Pontok összekötése
//DataSorting = DSCore.List.SortByKey(Pontlista_Jav,Szelveny_Jav);
SortedPontLista0 = DesignScript.Builtin.Dictionary.ValueAtKey(DataSorting,"sortedList");
SortedPontLista1 = Autodesk.DesignScript.Geometry.Point.PruneDuplicates(SortedPontLista0,0.0005);

n = DSCore.List.Count(SortedPontLista1);
Vonalak0 = Autodesk.DesignScript.Geometry.Line.ByStartPointEndPoint(SortedPontLista1[0.. n-2],SortedPontLista1[1.. n-1]);
Vonalak1 =DSCore.List.Clean(Vonalak0,false);
Vonallanc = Autodesk.DesignScript.Geometry.PolyCurve.ByJoinedCurves(Vonalak1, 0.001, false, 0);
# ----------------------------------------
code_block_37 = CodeBlock(VonalNev=code_block_3, AktualKOD=code_block_34)  # same code as code_block_25

# group: 3D vonallánc stílusa
color_palette_5 = ColorPalette({R: 101, G: 101, B: 101, A: 255})
choose_lineweight_5 = Lineweight("0.18 mm")
byName_5 = Autodesk.AutoCAD.DynamoNodes.Layer.ByName(name=code_block_37, document=setCoordinateReferenceSystem, color=color_palette_5, lineweight=choose_lineweight_5)
name_5 = Autodesk.AutoCAD.DynamoNodes.Layer.Name(layer=byName_5)
byGeometry_7 = Autodesk.AutoCAD.DynamoNodes.Polyline3D.ByGeometry(curve=code_block_36.Vonallanc, layerName=name_5)  # graph output

watch = Watch(code_block_36.Vonalak0)
boolean = BoolSelector(false)
clean = List.Clean(list=watch, preserveIndices=boolean)

# group: Cogo Pontok - Bal sínszal
# Cogo pontok létrehozása
code_block_38 = CodeBlock(VonalNev=code_block_3) { "VF_SZG_GEOD_" +VonalNev +"_BalSinszalCOGOPontok"; }
string_from_object_2 = FromObject(object=code_block_2.PontNev)
code_block_39 = CodeBlock(PontNev=string_from_object_2, PontKod=code_block_2.PontKod) { PontNev + "_" + PontKod; }
byGeometry_8 = Autodesk.Civil.DynamoNodes.CogoPoint.ByGeometry(point=byCoordinates_2, layerName=code_block_38, rawDescription=code_block_39)  # graph output

# group: COGO pont stílus
# note: Description Only
string_4 = StringInput("VF_Felirat")
setLabelStyle_2 = Autodesk.Civil.DynamoNodes.CogoPoint.SetLabelStyle(cogoPoint=byGeometry_8, labelStyleName=string_4)
string_5 = StringInput("VF_Sin")
setStyle_3 = Autodesk.Civil.DynamoNodes.CogoPoint.SetStyle(cogoPoint=setLabelStyle_2, styleName=string_5)

# group: Cogo Pontok - Jobb sínszál
# Cogo pontok léterhozása
code_block_40 = CodeBlock(VonalNev=code_block_3) { "VF_SZG_GEOD_" +VonalNev + "_JobbSinszalCOGOPontok"; }
string_from_object_3 = FromObject(object=code_block_2.PontNev)
# note: pontok egyedi elnevezése név és kód alapján
# pl. 101_vg
code_block_41 = CodeBlock(PontNev=string_from_object_3, PontKod=code_block_2.PontKod) { PontNev + "_" + PontKod; }
# note: Cogo pont
byGeometry_9 = Autodesk.Civil.DynamoNodes.CogoPoint.ByGeometry(point=byCoordinates_3, layerName=code_block_40, rawDescription=code_block_41)  # graph output

# group: COGO pont stílus
string_6 = StringInput("VF_Felirat")
# note: Cogo pont felirat stílus
setLabelStyle_3 = Autodesk.Civil.DynamoNodes.CogoPoint.SetLabelStyle(cogoPoint=byGeometry_9, labelStyleName=string_6)
string_7 = StringInput("VF_Sin")
# note: Cogo pont MARKER megjelenítési stílus
setStyle_4 = Autodesk.Civil.DynamoNodes.CogoPoint.SetStyle(cogoPoint=setLabelStyle_3, styleName=string_7)

# group: Sin COGO pontcsoport létrehozása
list_create = List.Create(item0=setStyle_3, item1=setStyle_4)
flatten = List.Flatten(list=list_create)
code_block_42 = CodeBlock(VonalNev=code_block_3) { VonalNev + "_GEDO_Sin"; }
byCogoPoints = Autodesk.Civil.DynamoNodes.CogoPointGroup.ByCogoPoints(cogoPoints=flatten, cogoPointGroupName=code_block_42)

# group: Cogo Pontok - Vaganytengfely
# Cogo pontok létrehozása
code_block_43 = CodeBlock(VonalNev=code_block_3) { "VF_SZG_GEOD_" +VonalNev +"_TengelyCOGOPontok"; }
string_from_object_4 = FromObject(object=code_block_2.PontNev)
code_block_44 = CodeBlock(PontNev=string_from_object_4, PontKod=code_block_2.PontKod) { PontNev + "_" + PontKod; }
byGeometry_10 = Autodesk.Civil.DynamoNodes.CogoPoint.ByGeometry(point=byCoordinates, layerName=code_block_43, rawDescription=code_block_44)  # graph output

# group: COGO pont stílus
string_8 = StringInput("VF_Felirat")
setLabelStyle_4 = Autodesk.Civil.DynamoNodes.CogoPoint.SetLabelStyle(cogoPoint=byGeometry_10, labelStyleName=string_8)
string_9 = StringInput("VF_Tengely")
setStyle_5 = Autodesk.Civil.DynamoNodes.CogoPoint.SetStyle(cogoPoint=setLabelStyle_4, styleName=string_9)

# group: Vágánytengely COGO pontcsoport létrehozása
code_block_45 = CodeBlock(VonalNev=code_block_3) { VonalNev + "_GEDO_vgt"; }
byCogoPoints_2 = Autodesk.Civil.DynamoNodes.CogoPointGroup.ByCogoPoints(cogoPoints=setStyle_5, cogoPointGroupName=code_block_45)

code_block_46 = CodeBlock(VonalNev=code_block_3, kod=groupByKey.uniqueKeys) { VonalNev + "_GEDO_" + kod; }
byCogoPoints_3 = Autodesk.Civil.DynamoNodes.CogoPointGroup.ByCogoPoints(cogoPoints=groupByKey.groups, cogoPointGroupName=code_block_46)

# group: 3D Poliline - Jobb sinszál
# AutoCad 3D vonallánc létrehozása a Dynamo pontokból
code_block_47 = CodeBlock { 0.25; }
pruneDuplicates_4 = Point.PruneDuplicates(points=byCoordinates_3, tolerance=code_block_47)
count_3 = List.Count(list=pruneDuplicates_4)
code_block_48 = CodeBlock(Pontok=pruneDuplicates_4, N=count_3) { Pontok; Pontok[0..N-2]; Pontok[1..N-1]; }
byStartPointEndPoint_3 = Line.ByStartPointEndPoint(startPoint=code_block_48.out1, endPoint=code_block_48.out2)
byJoinedCurves_3 = PolyCurve.ByJoinedCurves(curves=byStartPointEndPoint_3)
code_block_49 = CodeBlock(VonalNev=code_block_3) { "VF_SZG_GEOD_" + VonalNev +"_JobbSinszal"; }

# group: Jobb sínszál stílus
# Bal sínszál stílusának beállítása.
color_palette_6 = ColorPalette({R: 255, G: 0, B: 0, A: 255})
choose_lineweight_6 = Lineweight("0.18 mm")
byName_6 = Autodesk.AutoCAD.DynamoNodes.Layer.ByName(name=code_block_49, document=setCoordinateReferenceSystem, color=color_palette_6, lineweight=choose_lineweight_6)

name_6 = Autodesk.AutoCAD.DynamoNodes.Layer.Name(layer=byName_6)

# group (continued): 3D Poliline - Jobb sinszál
byGeometry_11 = Autodesk.AutoCAD.DynamoNodes.Polyline3D.ByGeometry(curve=byJoinedCurves_3, layerName=name_6)  # graph output

# group: PADKAJ 3D vonallánc
code_block_50 = CodeBlock { KodSzuro = "padkaj"; }
indexOf_5 = List.IndexOf(list=groupByKey.uniqueKeys, element=code_block_50)
code_block_51 = CodeBlock(Lista=groupByKey.groups, index=indexOf_5) { Lista[index]; }
easting_5 = Autodesk.Civil.DynamoNodes.CogoPoint.Easting(cogoPoint=code_block_51)
northing_5 = Autodesk.Civil.DynamoNodes.CogoPoint.Northing(cogoPoint=code_block_51)
elevation_5 = Autodesk.Civil.DynamoNodes.CogoPoint.Elevation(cogoPoint=code_block_51)
byCoordinates_9 = Point.ByCoordinates(x=easting_5, y=northing_5, z=elevation_5)
code_block_52 = CodeBlock(Nyomvonal=importLabelSet, PontLista=byCoordinates_9)  # same code as code_block_24
code_block_53 = CodeBlock(VonalNev=code_block_3, AktualKOD=code_block_50)  # same code as code_block_25

# group: 3D vonallánc stílusa
color_palette_7 = ColorPalette({R: 255, G: 133, B: 10, A: 255})
choose_lineweight_7 = Lineweight("0.18 mm")
byName_7 = Autodesk.AutoCAD.DynamoNodes.Layer.ByName(name=code_block_53, document=setCoordinateReferenceSystem, color=color_palette_7, lineweight=choose_lineweight_7)
name_7 = Autodesk.AutoCAD.DynamoNodes.Layer.Name(layer=byName_7)
byGeometry_12 = Autodesk.AutoCAD.DynamoNodes.Polyline3D.ByGeometry(curve=code_block_52.Vonallanc, layerName=name_7)  # graph output

# group: PADKAB 3D vonallánc
code_block_54 = CodeBlock { KodSzuro = "padkab"; }
indexOf_6 = List.IndexOf(list=groupByKey.uniqueKeys, element=code_block_54)
code_block_55 = CodeBlock(Lista=groupByKey.groups, index=indexOf_6) { Lista[index]; }
easting_6 = Autodesk.Civil.DynamoNodes.CogoPoint.Easting(cogoPoint=code_block_55)
northing_6 = Autodesk.Civil.DynamoNodes.CogoPoint.Northing(cogoPoint=code_block_55)
elevation_6 = Autodesk.Civil.DynamoNodes.CogoPoint.Elevation(cogoPoint=code_block_55)
byCoordinates_10 = Point.ByCoordinates(x=easting_6, y=northing_6, z=elevation_6)
code_block_56 = CodeBlock(Nyomvonal=importLabelSet, PontLista=byCoordinates_10)  # same code as code_block_24
code_block_57 = CodeBlock(VonalNev=code_block_3, AktualKOD=code_block_54)  # same code as code_block_25

# group: 3D vonallánc stílusa
color_palette_8 = ColorPalette({R: 255, G: 133, B: 10, A: 255})
choose_lineweight_8 = Lineweight("0.18 mm")
byName_8 = Autodesk.AutoCAD.DynamoNodes.Layer.ByName(name=code_block_57, document=setCoordinateReferenceSystem, color=color_palette_8, lineweight=choose_lineweight_8)
name_8 = Autodesk.AutoCAD.DynamoNodes.Layer.Name(layer=byName_8)
byGeometry_13 = Autodesk.AutoCAD.DynamoNodes.Polyline3D.ByGeometry(curve=code_block_56.Vonallanc, layerName=name_8)  # graph output

# group: MOCSANB 3D vonallánc
code_block_58 = CodeBlock { KodSzuro = "mocsanb"; }
indexOf_7 = List.IndexOf(list=groupByKey.uniqueKeys, element=code_block_58)
code_block_59 = CodeBlock(Lista=groupByKey.groups, index=indexOf_7) { Lista[index]; }
easting_7 = Autodesk.Civil.DynamoNodes.CogoPoint.Easting(cogoPoint=code_block_59)
northing_7 = Autodesk.Civil.DynamoNodes.CogoPoint.Northing(cogoPoint=code_block_59)
elevation_7 = Autodesk.Civil.DynamoNodes.CogoPoint.Elevation(cogoPoint=code_block_59)
byCoordinates_11 = Point.ByCoordinates(x=easting_7, y=northing_7, z=elevation_7)
code_block_60 = CodeBlock(Nyomvonal=importLabelSet, PontLista=byCoordinates_11)  # same code as code_block_24
code_block_61 = CodeBlock(VonalNev=code_block_3, AktualKOD=code_block_58)  # same code as code_block_25

# group: 3D vonallánc stílusa
color_palette_9 = ColorPalette({R: 0, G: 255, B: 191, A: 255})
choose_lineweight_9 = Lineweight("0.18 mm")
byName_9 = Autodesk.AutoCAD.DynamoNodes.Layer.ByName(name=code_block_61, document=setCoordinateReferenceSystem, color=color_palette_9, lineweight=choose_lineweight_9)
name_9 = Autodesk.AutoCAD.DynamoNodes.Layer.Name(layer=byName_9)
byGeometry_14 = Autodesk.AutoCAD.DynamoNodes.Polyline3D.ByGeometry(curve=code_block_60.Vonallanc, layerName=name_9)  # graph output

# group: MOCSANJ 3D vonallánc
code_block_62 = CodeBlock { KodSzuro = "mocsanj"; }
indexOf_8 = List.IndexOf(list=groupByKey.uniqueKeys, element=code_block_62)
code_block_63 = CodeBlock(Lista=groupByKey.groups, index=indexOf_8) { Lista[index]; }
easting_8 = Autodesk.Civil.DynamoNodes.CogoPoint.Easting(cogoPoint=code_block_63)
northing_8 = Autodesk.Civil.DynamoNodes.CogoPoint.Northing(cogoPoint=code_block_63)
elevation_8 = Autodesk.Civil.DynamoNodes.CogoPoint.Elevation(cogoPoint=code_block_63)
byCoordinates_12 = Point.ByCoordinates(x=easting_8, y=northing_8, z=elevation_8)
code_block_64 = CodeBlock(Nyomvonal=importLabelSet, PontLista=byCoordinates_12)  # same code as code_block_24
code_block_65 = CodeBlock(VonalNev=code_block_3, AktualKOD=code_block_62)  # same code as code_block_25

# group: 3D vonallánc stílusa
color_palette_10 = ColorPalette({R: 0, G: 255, B: 191, A: 255})
choose_lineweight_10 = Lineweight("0.18 mm")
byName_10 = Autodesk.AutoCAD.DynamoNodes.Layer.ByName(name=code_block_65, document=setCoordinateReferenceSystem, color=color_palette_10, lineweight=choose_lineweight_10)
name_10 = Autodesk.AutoCAD.DynamoNodes.Layer.Name(layer=byName_10)
byGeometry_15 = Autodesk.AutoCAD.DynamoNodes.Polyline3D.ByGeometry(curve=code_block_64.Vonallanc, layerName=name_10)  # graph output

# group: REZSUB 3D vonallánc
code_block_66 = CodeBlock { KodSzuro = "rezsub"; }
indexOf_9 = List.IndexOf(list=groupByKey.uniqueKeys, element=code_block_66)
code_block_67 = CodeBlock(Lista=groupByKey.groups, index=indexOf_9) { Lista[index]; }
easting_9 = Autodesk.Civil.DynamoNodes.CogoPoint.Easting(cogoPoint=code_block_67)
northing_9 = Autodesk.Civil.DynamoNodes.CogoPoint.Northing(cogoPoint=code_block_67)
elevation_9 = Autodesk.Civil.DynamoNodes.CogoPoint.Elevation(cogoPoint=code_block_67)
byCoordinates_13 = Point.ByCoordinates(x=easting_9, y=northing_9, z=elevation_9)
code_block_68 = CodeBlock(Nyomvonal=importLabelSet, PontLista=byCoordinates_13)  # same code as code_block_24
code_block_69 = CodeBlock(VonalNev=code_block_3, AktualKOD=code_block_66)  # same code as code_block_25

# group: 3D vonallánc stílusa
color_palette_11 = ColorPalette({R: 0, G: 255, B: 2, A: 255})
choose_lineweight_11 = Lineweight("0.18 mm")
byName_11 = Autodesk.AutoCAD.DynamoNodes.Layer.ByName(name=code_block_69, document=setCoordinateReferenceSystem, color=color_palette_11, lineweight=choose_lineweight_11)
name_11 = Autodesk.AutoCAD.DynamoNodes.Layer.Name(layer=byName_11)
byGeometry_16 = Autodesk.AutoCAD.DynamoNodes.Polyline3D.ByGeometry(curve=code_block_68.Vonallanc, layerName=name_11)  # graph output

groupByKey_2 = List.GroupByKey(list=byGeometry_3, keys=code_block_17.out1)

# group: Blokk illesztése szelvénykő
code_block_70 = CodeBlock { "HKTMKO"; }
import_ = Autodesk.AutoCAD.DynamoNodes.Block.Import(drawingFilePath=topo_fájl_betöltése, blockName=code_block_70)
code_block_71 = CodeBlock { KodSzuro = "szko"; }
indexOf_10 = List.IndexOf(list=groupByKey_2.uniqueKeys, element=code_block_71)
code_block_72 = CodeBlock(Lista=groupByKey_2.groups, index=indexOf_10) { Lista[index]; }
easting_10 = Autodesk.Civil.DynamoNodes.CogoPoint.Easting(cogoPoint=code_block_72)
northing_10 = Autodesk.Civil.DynamoNodes.CogoPoint.Northing(cogoPoint=code_block_72)
elevation_10 = Autodesk.Civil.DynamoNodes.CogoPoint.Elevation(cogoPoint=code_block_72)
# note: pontok koordinátáinak lekérdezése
byCoordinates_14 = Point.ByCoordinates(x=easting_10, y=northing_10, z=elevation_10)
code_block_73 = CodeBlock(kOD=code_block_71) { "VF_SZG_GEOD_" + kOD; }
# note: blokk illesztése a megadott koordinátákra
byPoint = Autodesk.AutoCAD.DynamoNodes.BlockReference.ByPoint(sourceBlock=import_, insertionPoint=byCoordinates_14, layerName=code_block_73)  # graph output

code_block_74 = CodeBlock { "Nincs_Marker"; }
setStyle_6 = Autodesk.Civil.DynamoNodes.CogoPoint.SetStyle(cogoPoint=code_block_72, styleName=code_block_74)
kabelkoPontok = Watch(setStyle_6)  # graph output

# group: Blokk illesztése pályatelefon
code_block_75 = CodeBlock { "VOTELEF"; }
import_2 = Autodesk.AutoCAD.DynamoNodes.Block.Import(drawingFilePath=topo_fájl_betöltése, blockName=code_block_75)
code_block_76 = CodeBlock { KodSzuro = "tel"; }
indexOf_11 = List.IndexOf(list=groupByKey_2.uniqueKeys, element=code_block_76)
code_block_77 = CodeBlock(Lista=groupByKey_2.groups, index=indexOf_11) { Lista[index]; }
easting_11 = Autodesk.Civil.DynamoNodes.CogoPoint.Easting(cogoPoint=code_block_77)
northing_11 = Autodesk.Civil.DynamoNodes.CogoPoint.Northing(cogoPoint=code_block_77)
elevation_11 = Autodesk.Civil.DynamoNodes.CogoPoint.Elevation(cogoPoint=code_block_77)
# note: pontok koordinátáinak lekérdezése
byCoordinates_15 = Point.ByCoordinates(x=easting_11, y=northing_11, z=elevation_11)
code_block_78 = CodeBlock(kOD=code_block_76) { "VF_SZG_GEOD_" + kOD; }
# note: blokk illesztése a megadott koordinátákra
byPoint_2 = Autodesk.AutoCAD.DynamoNodes.BlockReference.ByPoint(sourceBlock=import_2, insertionPoint=byCoordinates_15, layerName=code_block_78)  # graph output

code_block_79 = CodeBlock { "Nincs_Marker"; }
setStyle_7 = Autodesk.Civil.DynamoNodes.CogoPoint.SetStyle(cogoPoint=code_block_77, styleName=code_block_79)
kabelkoPontok_2 = Watch(setStyle_7)  # graph output

# group: Blokk illesztése biztosítóberendezés
code_block_80 = CodeBlock { "BBFENA_1"; }
import_3 = Autodesk.AutoCAD.DynamoNodes.Block.Import(drawingFilePath=topo_fájl_betöltése, blockName=code_block_80)
code_block_81 = CodeBlock { KodSzuro = "bizber"; }
indexOf_12 = List.IndexOf(list=groupByKey_2.uniqueKeys, element=code_block_81)
code_block_82 = CodeBlock(Lista=groupByKey_2.groups, index=indexOf_12) { Lista[index]; }
easting_12 = Autodesk.Civil.DynamoNodes.CogoPoint.Easting(cogoPoint=code_block_82)
northing_12 = Autodesk.Civil.DynamoNodes.CogoPoint.Northing(cogoPoint=code_block_82)
elevation_12 = Autodesk.Civil.DynamoNodes.CogoPoint.Elevation(cogoPoint=code_block_82)
# note: pontok koordinátáinak lekérdezése
byCoordinates_16 = Point.ByCoordinates(x=easting_12, y=northing_12, z=elevation_12)
code_block_83 = CodeBlock(kOD=code_block_81) { "VF_SZG_GEOD_" + kOD; }
# note: blokk illesztése a megadott koordinátákra
byPoint_3 = Autodesk.AutoCAD.DynamoNodes.BlockReference.ByPoint(sourceBlock=import_3, insertionPoint=byCoordinates_16, layerName=code_block_83)  # graph output

code_block_84 = CodeBlock { "Nincs_Marker"; }
setStyle_8 = Autodesk.Civil.DynamoNodes.CogoPoint.SetStyle(cogoPoint=code_block_82, styleName=code_block_84)
kabelkoPontok_3 = Watch(setStyle_8)  # graph output
