# Dynamo graph WORKFLOW_TrimbleGEDO_ProfilerLoad_v1_14.dyn (Dynamo 3.6.1.9956)
# author: Veres Fanni
# Trimble GEDO Profilerrel mért pontok betöltése.
# A Profiler pontokat tartalmazó file-t kell kiválasztani.
# Filenévsablon: ProjektEvHonapNap_GEDO_xxSzakasz_profiler

# group: Bemenő adatok
profiler_mérési_fájl_betöltése = Filename("INPUT fájlok\Szentgal260318_GEDO_01szakasz_profiler.csv")  # graph input
current = Autodesk.AutoCAD.DynamoNodes.Document.Current()
string = StringInput("HD72/7Pa.EOV")
setCoordinateReferenceSystem = Autodesk.AutoCAD.DynamoNodes.Document.SetCoordinateReferenceSystem(document=current, code=string)

# note: CSV fájl betöltése
# (vesszővel tagolt csv fájl kell!)
importCSV = Data.ImportCSV(filePath=profiler_mérési_fájl_betöltése)
code_block = CodeBlock(NyersAdatok=importCSV)
# ---------- code_block.designscript (14 lines) ----------
//PontNév
Nev = List.RestOfItems(NyersAdatok[0]);
//Kód
Kod = List.RestOfItems(NyersAdatok[1]);
//Vonalnév
VonalNev = List.RestOfItems(NyersAdatok[2]);
//Szelvény
Szelveny = List.RestOfItems(NyersAdatok[3]);
// X koordináta
x = List.RestOfItems(NyersAdatok[4]);
// Y koordináta
y = List.RestOfItems(NyersAdatok[5]);
// Z koordináta
z = List.RestOfItems(NyersAdatok[6]);
# ----------------------------------------
watch = Watch(code_block.VonalNev)
watch_2 = Watch(code_block.Szelveny)
watch_3 = Watch(code_block.x)
watch_4 = Watch(code_block.y)
watch_5 = Watch(code_block.z)

# group: Dynamo pont
# Dynamo pontok létrehozása xyz koodinátákból
byCoordinates = Point.ByCoordinates(x=watch_3, y=watch_4, z=watch_5)

# group: Cogo pontok létrehozása > MindenCOGOPont fólia
code_block_2 = CodeBlock { "PROF_Mindenpont"; }
color_palette = ColorPalette({R: 255, G: 255, B: 255, A: 255})
choose_lineweight = Lineweight("0.30 mm")
byName = Autodesk.AutoCAD.DynamoNodes.Layer.ByName(name=code_block_2, color=color_palette, lineweight=choose_lineweight)

watch_6 = Watch(code_block.Nev)
watch_7 = Watch(code_block.Kod)

# group: Cogo pontok létrehozása
name = Autodesk.AutoCAD.DynamoNodes.Layer.Name(layer=byName)
string_from_object = FromObject(object=watch_6)
string_from_object_2 = FromObject(object=watch_7)
code_block_3 = CodeBlock(a=string_from_object, b=string_from_object_2) { a + "_" + b; }
byGeometry = Autodesk.Civil.DynamoNodes.CogoPoint.ByGeometry(point=byCoordinates, layerName=name, rawDescription=code_block_3)  # graph output

# group: COGO pont stílus
# note: szöveges leírás
string_2 = StringInput("VF_Felirat")
setLabelStyle = Autodesk.Civil.DynamoNodes.CogoPoint.SetLabelStyle(cogoPoint=byGeometry, labelStyleName=string_2)
string_3 = StringInput("VF_Profiler")
setStyle = Autodesk.Civil.DynamoNodes.CogoPoint.SetStyle(cogoPoint=setLabelStyle, styleName=string_3)

# group: COGO pont csoport létrehozása
flatten = List.Flatten(list=byGeometry)
groupByKey = List.GroupByKey(list=flatten, keys=watch_7)
code_block_4 = CodeBlock(kodocska=groupByKey.uniqueKeys) { "PROF_" + kodocska; }
byCogoPoints = Autodesk.Civil.DynamoNodes.CogoPointGroup.ByCogoPoints(cogoPoints=groupByKey.groups, cogoPointGroupName=code_block_4)
