# Dynamo graph WORKFLOW_GPS-RTKLoad_v3_3.dyn (Dynamo 3.6.1.9956)
# author: Veres Fanni
# Trimble GPS RTK-val mért adatok betöltése.
# A GPS RTK pontokat tartalmazó file-t kell kiválasztani.
# Filenévsablon: PojektEvHonapNap_RTK_munkafolyamat

# group: Bemenő adatok
current = Autodesk.AutoCAD.DynamoNodes.Document.Current()
string = StringInput("HD72/7Pa.EOV")
setCoordinateReferenceSystem = Autodesk.AutoCAD.DynamoNodes.Document.SetCoordinateReferenceSystem(document=current, code=string)
gps_rtk_fájlok_betöltése = Filename("INPUT fájlok\Szentgal_RTK_egyesített.csv")  # graph input

# note: CSV fájl betöltése
# (vesszővel tagolt CSV fájl kell!
importCSV = Data.ImportCSV(filePath=gps_rtk_fájlok_betöltése)
code_block = CodeBlock(NyersAdatok=importCSV)
# ---------- code_block.designscript (10 lines) ----------
//Pontnév
Nev = List.RestOfItems(NyersAdatok[0]);
//x koordináta
x = List.RestOfItems(NyersAdatok[1]);
//y koordináta
y = List.RestOfItems(NyersAdatok[2]);
//z koordináta (magasság)
z = List.RestOfItems(NyersAdatok[3]);
//Kód
Kod = List.RestOfItems(NyersAdatok[4]);
# ----------------------------------------
watch = Watch(code_block.x)
watch_2 = Watch(code_block.y)
watch_3 = Watch(code_block.z)
watch_4 = Watch(code_block.Nev)
watch_5 = Watch(code_block.Kod)

# group: Pontok és COGO pontok létrehozása
# note: Dynamo pontok
byCoordinates = Point.ByCoordinates(x=watch, y=watch_2, z=watch_3)
string_2 = StringInput("VF_SZG_GEOD_RTK_Mindenpont")
string_from_object = FromObject(object=watch_4)
code_block_2 = CodeBlock(a=string_from_object, b=watch_5) { a+"_"+b; }
byGeometry = Autodesk.Civil.DynamoNodes.CogoPoint.ByGeometry(point=byCoordinates, layerName=string_2, rawDescription=code_block_2)

# group: COGO pont stílus
code_block_3 = CodeBlock { "VF_Felirat"; }
setLabelStyle = Autodesk.Civil.DynamoNodes.CogoPoint.SetLabelStyle(cogoPoint=byGeometry, labelStyleName=code_block_3)
string_3 = StringInput("VF_Topo")
setStyle = Autodesk.Civil.DynamoNodes.CogoPoint.SetStyle(cogoPoint=setLabelStyle, styleName=string_3)

# group: Pontkódok szűrése, pontcsoportok létrehozása
uniqueItems = List.UniqueItems(list=watch_5)
getItemAtIndex = List.GetItemAtIndex()  # unwired: list, index
groupByFunction = List.GroupByFunction(list=uniqueItems, groupFunction=getItemAtIndex)
allIndicesOf = List.AllIndicesOf(list=watch_5, item=groupByFunction)
getItemAtIndex_2 = List.GetItemAtIndex(list=byGeometry, index=allIndicesOf)
code_block_4 = CodeBlock(Kod=groupByFunction) { "RTK_" + Kod; }
byCogoPoints = Autodesk.Civil.DynamoNodes.CogoPointGroup.ByCogoPoints(cogoPoints=getItemAtIndex_2, cogoPointGroupName=code_block_4)

groupByKey = List.GroupByKey(list=byGeometry, keys=code_block.Kod)

# group: Blokk illesztése kábeljelölő kő
# note: kábeljelölő szelvénykő blokk (sablonfile tartalmazza)
code_block_5 = CodeBlock { "KABJELKO"; }
import_ = Autodesk.AutoCAD.DynamoNodes.Block.Import(drawingFilePath=gps_rtk_fájlok_betöltése, blockName=code_block_5)
code_block_6 = CodeBlock { KodSzuro = "kabelko"; }
indexOf = List.IndexOf(list=groupByKey.uniqueKeys, element=code_block_6)
code_block_7 = CodeBlock(Lista=groupByKey.groups, index=indexOf) { Lista[index]; }
easting = Autodesk.Civil.DynamoNodes.CogoPoint.Easting(cogoPoint=code_block_7)
northing = Autodesk.Civil.DynamoNodes.CogoPoint.Northing(cogoPoint=code_block_7)
elevation = Autodesk.Civil.DynamoNodes.CogoPoint.Elevation(cogoPoint=code_block_7)
# note: pontok koordinátáinak lekérdezése
byCoordinates_2 = Point.ByCoordinates(x=easting, y=northing, z=elevation)
code_block_8 = CodeBlock(kOD=code_block_6) { "VF_SZG_GEOD_" + kOD; }
# note: blokk illesztése a megadott koordinátákra
byPoint = Autodesk.AutoCAD.DynamoNodes.BlockReference.ByPoint(sourceBlock=import_, insertionPoint=byCoordinates_2, layerName=code_block_8)  # graph output

# group: FájlNév
# fájl nevéből is megadható lenne a "mindenpont" fólia, ha ezt a kimenetet kötnénk a fájlnévbe
fileName = FileSystem.FileName(path=gps_rtk_fájlok_betöltése)
code_block_9 = CodeBlock { "."; }
split = String.Split(string=fileName, separator0=code_block_9)
code_block_10 = CodeBlock(InputFileName=split) { InputFileName[0]; }

# group: Blokk illesztése - ideiglenes vezetékoszlop
# note: felsővezetékoszlop jelölő blokk (sablonfile tartalmazza)
code_block_11 = CodeBlock { "OLFEVEBE"; }
# note: szerepelnie kell a sablonfileban
import_2 = Autodesk.AutoCAD.DynamoNodes.Block.Import(drawingFilePath=gps_rtk_fájlok_betöltése, blockName=code_block_11)
string_4 = StringInput("Ideigvezoszlop")
indexOf_2 = List.IndexOf(list=groupByKey.uniqueKeys, element=string_4)
code_block_12 = CodeBlock(Lista=groupByKey.groups, index=indexOf_2) { Lista[index]; }
easting_2 = Autodesk.Civil.DynamoNodes.CogoPoint.Easting(cogoPoint=code_block_12)
northing_2 = Autodesk.Civil.DynamoNodes.CogoPoint.Northing(cogoPoint=code_block_12)
elevation_2 = Autodesk.Civil.DynamoNodes.CogoPoint.Elevation(cogoPoint=code_block_12)
# note: pontok koordinátáinak lekérdezése
byCoordinates_3 = Point.ByCoordinates(x=easting_2, y=northing_2, z=elevation_2)
code_block_13 = CodeBlock(kOD=string_4) { "VF_SZG_GEOD_" + kOD; }
# note: blokk illesztése a megadott koordinátákra
byPoint_2 = Autodesk.AutoCAD.DynamoNodes.BlockReference.ByPoint(sourceBlock=import_2, insertionPoint=byCoordinates_3, layerName=code_block_13)  # graph output

code_block_14 = CodeBlock { "Nincs_Marker"; }
setStyle_2 = Autodesk.Civil.DynamoNodes.CogoPoint.SetStyle(cogoPoint=code_block_7, styleName=code_block_14)
kabelkoPontok = Watch(setStyle_2)  # graph output
